test file "DCFC_Test_Cases"

suite "New Test Suite 1"

  case "15.5.0.2.a" [baseline]
    model Simulink_Program, harness Simulink_Program_Harness1 (for Simulink_Program/Subsystem/Plug-In Charging/dcfc)
    assessment callback:
      verify(HVBatChargeStat == 0,'Test 15.5.0.2.a')

  case "15.5.0.2.b" [baseline]
    model Simulink_Program, harness Simulink_Program_Harness1 (for Simulink_Program/Subsystem/Plug-In Charging/dcfc)

  case "15.5.0.3.a" [baseline]
    model Simulink_Program, harness Simulink_Program_Harness1 (for Simulink_Program/Subsystem/Plug-In Charging/dcfc)

  case "15.5.0.3.b" [baseline]
    model Simulink_Program, harness Simulink_Program_Harness1 (for Simulink_Program/Subsystem/Plug-In Charging/dcfc)

  case "15.5.0.3.c" [baseline]
    model Simulink_Program, harness Simulink_Program_Harness1 (for Simulink_Program/Subsystem/Plug-In Charging/dcfc)

  case "15.5.0.4.a" [baseline]
    model Simulink_Program, harness Simulink_Program_Harness1 (for Simulink_Program/Subsystem/Plug-In Charging/dcfc)

  case "15.5.0.4.b" [baseline]
    model Simulink_Program, harness Simulink_Program_Harness1 (for Simulink_Program/Subsystem/Plug-In Charging/dcfc)

  case "15.5.0.5" [baseline]
    model Simulink_Program, harness Simulink_Program_Harness1 (for Simulink_Program/Subsystem/Plug-In Charging/dcfc)

  case "15.5.0.6" [baseline]
    model Simulink_Program, harness Simulink_Program_Harness1 (for Simulink_Program/Subsystem/Plug-In Charging/dcfc)

  case "15.5.0.7" [baseline]
    model Simulink_Program, harness Simulink_Program_Harness1 (for Simulink_Program/Subsystem/Plug-In Charging/dcfc)

  case "15.5.0.8" [baseline]
    model Simulink_Program, harness Simulink_Program_Harness1 (for Simulink_Program/Subsystem/Plug-In Charging/dcfc)

  case "15.5.0.9.a" [baseline]
    model Simulink_Program, harness Simulink_Program_Harness1 (for Simulink_Program/Subsystem/Plug-In Charging/dcfc)

  case "15.5.0.9.b" [baseline]
    model Simulink_Program, harness Simulink_Program_Harness1 (for Simulink_Program/Subsystem/Plug-In Charging/dcfc)